test file "InfusionPumpTest"
  coverage: Decision, MCDC, Condition

suite "Motor Control Test"
  description: This test is designed to test the functionality of bolus mode alone.
  setup callback:
    run InitializationInsulinPump.m
  cleanup callback:
    clear
    % close all

    run Analy_TimeSeriesFeatureExtration.m

  case "Polyspace Dead Test" [simulation] (disabled)
    model MotorController
    custom criteria:
      import polyspace.customTestConstraints.allCodeIsLogicallyReachable;
      import polyspace.customTestConstraints.runTimeChecksAllGreen;
      % Generate Code and Prove
      resultsFolder = CodeGenAndProve(sltest_sut{1},'NO PRJFILE');

      resultsObj = polyspace.CodeProverResults(resultsFolder);

      % summary = resultsObj.getSummary;

      test.verifyThat(resultsObj.getResults(),allCodeIsLogicallyReachable);
      test.verifyThat(resultsObj.getResults(),runTimeChecksAllGreen);
      % test.verifyEmpty(getRedFiles(summary),'Reds Detection');
      % test.verifyEmpty(getGrayFiles(summary),'Greys Detected');
      % test.verifyEmpty(getOrangeFiles(summary),'Oranges Detected');

  case "Extending Test Case" [simulation]
    model MotorController, harness MotorController_Harness2

suite "Fault Detector Test"
  description: This test is meant to test whether the fault detector is working well for a wide range of test cases
  setup callback:
    run Analy_TimeSeriesFeatureExtration.m
  cleanup callback:
    clear

  case "Occlusion detection check" [simulation]
    model OcclusionDetection, harness OcclusionDetection_Harness1 (for OcclusionDetection/Occlusion1)
    iteration script:
      %% Iterate over all Signal Builder Groups and Parameters

      % Determine the number of possible iterations
      numSteps = 180-18;
      % numSteps = 180;

      % Set up the parameter values to sweep over
      IdxVec = [2:10 12:20 22:30 32:40 42:50 52:60 ...
                 62:70 72:80 82:90 92:100 102:110 112:120 ...
                 122:130 132:140 142:150 152:160 162:170 172:180];
      % IdxVec = 1:180;

      % Create each iteration
      for k = 1 : numSteps
          % Set up a new iteration object
          testItr = sltestiteration;

          % Set value of lei (parameter in model workspace)
          setVariable(testItr,'Name','idx','Source','base workspace',...
                      'Value',IdxVec(k));

          % Add the iteration to run in this test case
          addIteration(sltest_testCase,testItr);
      end

  case "Occlusion detection check ML Classifier" [simulation] (disabled)
    model OcclusionDetection, harness OcclusionDetection_Harness2 (for OcclusionDetection/Occlusion2)
    iteration script:
      %% Iterate over all Signal Builder Groups and Parameters

      % Determine the number of possible iterations
      numSteps = 180-18;
      %numSteps = 1;

      % Set up the parameter values to sweep over
      IdxVec = [2:10 12:20 22:30 32:40 42:50 52:60 ...
                 62:70 72:80 82:90 92:100 102:110 112:120 ...
                 122:130 132:140 142:150 152:160 162:170 172:180];
      % IdxVec = 1:180;

      % Create each iteration
      for k = 1 : numSteps
          % Set up a new iteration object
          testItr = sltestiteration;

          % Set value of lei (parameter in model workspace)
          setVariable(testItr,'Name','idx','Source','base workspace',...
                      'Value',IdxVec(k));

          % Add the iteration to run in this test case
          addIteration(sltest_testCase,testItr);
      end

suite "Supervisory Test"

  case "Loop Through Signal Build Groups" [simulation]
    model Supervisory, harness Supervisory_Harness_Basal (for Supervisory/BasalChart)
    iteration script:
      %% Iterate over all Signal Builder Groups.

      % Determine the number of possible iterations
      numSteps = length(sltest_signalBuilderGroups);

      % Create each iteration
      for k = 1 : numSteps
          % Set up a new iteration object
          testItr = sltestiteration();

          % Set iteration settings
          setTestParam(testItr, 'SignalBuilderGroup', sltest_signalBuilderGroups{k});

          % Register the iteration to run in this test case
          addIteration(sltest_testCase, testItr); % You can pass in an optional iteration name
      end

  case "Polyspace Dead Code Test" [simulation] (disabled)
    model Supervisory, harness Supervisory_Harness_Basal (for Supervisory/BasalChart)
    custom criteria: same code as in custom criteria of case "Polyspace Dead Test"

suite "Integration Test"
  setup callback:
    run InitializationInsulinPump.m

  case "Test Closed Loop System" [simulation]
    model ExchangeTransfusiondeviceModel, harness Test_Sequence_Control_Harness1
    pre-load callback:
      InitializationInsulinPump

suite "Motor Control SIL Test"

  case "SIL Equivalence Test" [equivalence]
    simulation 1:
      model MotorController, harness MotorController_Harness1, mode Normal
    simulation 2:
      model MotorController, harness MotorController_SIL_Harness3, mode Normal
    equivalence criteria
      MotorController:1